# Grasshopper definition Worley_Noise_01.gh (Grasshopper 1.0.7)

number_slider = Slider(2, range=0..10)
number_slider_2 = Slider(10, range=0..100)
number_slider_3 = Slider(10, range=0..100)
number_slider_4 = Slider(10, range=0..100)
construct_point = ConstructPoint(XCoordinate=0, YCoordinate=0, ZCoordinate=0)
rectangle = Rectangle(Plane=PlaneXY(0, 0, 0), XSize=number_slider, YSize=number_slider, Radius=0)  # -> Rectangle, Length
series = Series(Start=0, Step=1, Count=number_slider_4)
c_script = CSharpScript(x=number_slider_2, y=number_slider_3, z=number_slider_4, num=Slider(5, range=0..10))  # -> out, A; inputs x: Int32, y: Int32, z: Int32, num: Int32
# ---------- c_script: C# ----------
    List<Point3d> pts = new List<Point3d>();
    Random rand = new Random();

    for(int i = 0; i < num; i++){
      double x1 = rand.Next(x );
      double y1 = rand.Next(y );
      double z1 = rand.Next(z );
      pts.Add(new Point3d(x1, y1, z1));
    }

    A = pts;
# ---------- end c_script ----------
unit_z = UnitZ(Factor=series)  # -> graft(UnitVector)
rectangular_array = RectangularArray(Geometry=construct_point, Cell=rectangle.Rectangle, XCount=number_slider_2, YCount=number_slider_3)  # -> Geometry, Transform
panel = Panel(c_script.A)
sphere = Sphere(Base=c_script.A, Radius=1)
move = Move(Geometry=rectangular_array.Geometry, Motion=unit_z)  # -> simplify(Geometry), Transform
param_viewer = ParamViewer(move.Geometry)
c_script_2 = CSharpScript(x=move.Geometry, y=c_script.A)  # -> out, A; inputs x: tree of Point3d, y: list of Point3d
# ---------- c_script_2: C# usings ----------
using System.Drawing;
# ---------- c_script_2: C# ----------
    
    DataTree<GH_Colour> cols = new DataTree<GH_Colour>();
     DataTree<double> di = new DataTree<double>();
    
    for(int i = 0; i < x.BranchCount; i++){
      GH_Path pa = new GH_Path(i);

      for(int j = 0; j < x.Branch(i).Count; j++){
        
        List<double> dists = new List<double>();
        for(int k = 0; k < y.Count; k++){
          double dist = x.Branch(i)[j].DistanceTo(y[k]);
          dists.Add(dist);
        }
        dists.Sort();
        
        //Color cl = Color.FromArgb(i, j, 0);
        //Color cl = Color.FromArgb((int)dists[0]);
        //GH_Colour col = new GH_Colour(cl);
        
        //cols.Add(col, pa);   
        di.Add(dists[0], pa);
        
      }
    }
    
    A = di;
# ---------- end c_script_2 ----------
flatten_tree = FlattenTree(Tree=c_script_2.A, Path="{0}")
sort_list = SortList(Keys=flatten_tree)  # -> Keys, ValuesA
panel_2 = Panel("255")
construct_domain = ConstructDomain(DomainStart=0, DomainEnd="255")
list_item = ListItem(List=sort_list.Keys, Index=0, Wrap=True)  # -> Item1, Item
construct_domain_2 = ConstructDomain(DomainStart=0, DomainEnd=list_item.Item1)
remap_numbers = RemapNumbers(Value=c_script_2.A, Source=construct_domain_2, Target=construct_domain)  # -> Mapped, Clipped
colour_rgb = ColourRGB(Alpha=255, Red=remap_numbers.Mapped, Green=remap_numbers.Mapped, Blue=remap_numbers.Mapped)
custom_preview = CustomPreview(Geometry=move.Geometry, Material=colour_rgb)
panel_3 = Panel(remap_numbers.Mapped)
