# Grasshopper definition Room_Data_01.gh (Grasshopper 1.0.7)
# plug-ins: Konstru

max_pt = Panel("""4.66666666666667
7.16666666666668
0""")
min_pt = Panel("""-4.66666666666667
-7.16666666666668
0""")
levels = Panel("""0
10""")
max_pt_2 = Panel("""-0.161300525575361
-1.63108976609036
5""")
min_pt_2 = Panel("""-9.49463385890869
-15.9644230994237
0""")
panel = Panel("""-0.161300525575361
-15.9644230994237
4""")
panel_2 = Panel("""-0.161300525575361
-1.63108976609039
4""")
panel_3 = Panel("""-9.494633859
-15.964423099
4.000000000""")
panel_4 = Panel("""-0.161300526
-15.964423099
4.000000000""")
panel_5 = Panel("""-9.494633859
-1.631089766
4.000000000""")
panel_6 = Panel("""-9.494633859
-15.964423099
4.000000000""")
panel_7 = Panel("""-0.161300526
-1.631089766
4.000000000""")
panel_8 = Panel("""-9.494633859
-1.631089766
4.000000000""")
panel_9 = Panel("""-0.161300526
-3.464995135
5.000000000""")
panel_10 = Panel("""-9.494633859
-12.798328469
5.000000000""")
panel_11 = Panel("""-0.161300526
-13.311363170
5.000000000""")
panel_12 = Panel("""-9.494633859
-3.978029836
5.000000000""")
panel_13 = Panel("""Startpoint (45.005366141, -1.631089766, 30.000000000) Endpoint (45.005366141, -16.631089766, 30.000000000)
Startpoint (45.005366141, -16.631089766, 30.000000000) Endpoint (53.172032808, -16.631089766, 30.000000000)
Startpoint (53.172032808, -16.631089766, 30.000000000) Endpoint (53.172032808, -1.631089766, 30.000000000)
Startpoint (53.172032808, -1.631089766, 30.000000000) Endpoint (45.005366141, -1.631089766, 30.000000000)
Startpoint (45.005366141, -16.631089766, 0.000000000) Endpoint (45.005366141, -1.631089766, 0.000000000)
Startpoint (45.005366141, -1.631089766, 0.000000000) Endpoint (60.005366141, -1.631089766, 0.000000000)
Startpoint (60.005366141, -1.631089766, 0.000000000) Endpoint (60.005366141, -16.631089766, 0.000000000)
Startpoint (60.005366141, -16.631089766, 0.000000000) Endpoint (45.005366141, -16.631089766, 0.000000000)
Startpoint (45.005366141, -1.631089766, 30.000000000) Endpoint (45.005366141, -1.631089766, 0.000000000)
Startpoint (60.005366141, -16.631089766, 10.500000000) Endpoint (53.172032808, -16.631089766, 10.500000000)
Startpoint (53.172032808, -16.631089766, 10.500000000) Endpoint (53.172032808, -16.631089766, 30.000000000)
Startpoint (45.005366141, -16.631089766, 0.000000000) Endpoint (45.005366141, -16.631089766, 30.000000000)
Startpoint (60.005366141, -1.631089766, 10.500000000) Endpoint (60.005366141, -16.631089766, 10.500000000)
Startpoint (60.005366141, -16.631089766, 0.000000000) Endpoint (60.005366141, -16.631089766, 10.500000000)
Startpoint (53.172032808, -1.631089766, 30.000000000) Endpoint (53.172032808, -1.631089766, 10.500000000)
Startpoint (53.172032808, -1.631089766, 10.500000000) Endpoint (60.005366141, -1.631089766, 10.500000000)
Startpoint (60.005366141, -1.631089766, 0.000000000) Endpoint (60.005366141, -1.631089766, 10.500000000)
Startpoint (53.172032808, -1.631089766, 10.500000000) Endpoint (53.172032808, -16.631089766, 10.500000000)""")
panel_14 = Panel("minPt = {(45.005366141, -16.631089766, 0.000000000)}")
panel_15 = Panel("maxPt = {(60.005366141, -1.631089766, 30.000000000)}")
numbers_to_points = NumbersToPoints(Numbers=max_pt, Mask=4)
numbers_to_points_2 = NumbersToPoints(Numbers=min_pt, Mask=4)
construct_point = ConstructPoint(XCoordinate=0, YCoordinate=0, ZCoordinate=levels)
list_item = ListItem(List=levels, Index=0, Wrap=True)  # -> Item, Item1
rectangle = Rectangle(Plane=PlaneXY(0, 0, 0), XSize="10", YSize="15", Radius=0)  # -> Rectangle, Length
numbers_to_points_3 = NumbersToPoints(Numbers=max_pt_2, Mask=4)
numbers_to_points_4 = NumbersToPoints(Numbers=min_pt_2, Mask=4)
numbers_to_points_5 = NumbersToPoints(Numbers=panel, Mask=4)
numbers_to_points_6 = NumbersToPoints(Numbers=panel_2, Mask=4)
numbers_to_points_7 = NumbersToPoints(Numbers=panel_3, Mask=4)
numbers_to_points_8 = NumbersToPoints(Numbers=panel_4, Mask=4)
numbers_to_points_9 = NumbersToPoints(Numbers=panel_5, Mask=4)
numbers_to_points_10 = NumbersToPoints(Numbers=panel_6, Mask=4)
numbers_to_points_11 = NumbersToPoints(Numbers=panel_7, Mask=4)
numbers_to_points_12 = NumbersToPoints(Numbers=panel_8, Mask=4)
numbers_to_points_13 = NumbersToPoints(Numbers=panel_9, Mask=4)
numbers_to_points_14 = NumbersToPoints(Numbers=panel_10, Mask=4)
numbers_to_points_15 = NumbersToPoints(Numbers=panel_11, Mask=4)
numbers_to_points_16 = NumbersToPoints(Numbers=panel_12, Mask=4)
box_2pt = Box2Pt(PointA=numbers_to_points, PointB=numbers_to_points_2, Plane=PlaneXY(0, 0, 0))
rectangle_2pt = Rectangle2Pt(Plane=PlaneXY(0, 0, 0), PointA=numbers_to_points, PointB=numbers_to_points_2, Radius=0)  # -> Rectangle, Length
explode = Explode(Curve=rectangle.Rectangle, Recursive=True)  # -> Segments, Vertices
xy_plane = XYPlane(Origin=construct_point)
box_2pt_2 = Box2Pt(PointA=numbers_to_points_3, PointB=numbers_to_points_4, Plane=PlaneXY(0, 0, 0))
area = Area(Geometry=rectangle_2pt.Rectangle)  # -> Area, Centroid
panel_16 = Panel("""-0.161300526
-1.631089766
5.000000000""")
panel_17 = Panel("""-9.494633859
-1.631089766
5.000000000""")
panel_18 = Panel("""-9.494633859
-1.631089766
5.000000000""")
panel_19 = Panel("""-9.494633859
-15.964423099
5.000000000""")
panel_20 = Panel("""-0.161300526
-15.964423099
5.000000000""")
panel_21 = Panel("""-9.494633859
-15.964423099
5.000000000""")
panel_22 = Panel("""-0.161300526
-15.964423099
5.000000000""")
panel_23 = Panel("""-0.161300526
-1.631089766
5.000000000""")
wall = Wall(Curve=explode.Segments, Height=list_item.Item1, Width=Slider(0.75, range=0..1))  # -> flatten(Element), flatten(Geometry)
deconstruct_box = DeconstructBox(Box=box_2pt_2)  # -> Plane, X, Y, Z
box_corners = BoxCorners(Box=box_2pt_2)  # -> CornerA, CornerB, CornerC, CornerD, CornerE, CornerF, CornerG, CornerH
panel_24 = Panel(area.Area)
numbers_to_points_17 = NumbersToPoints(Numbers=panel_16, Mask=4)
numbers_to_points_18 = NumbersToPoints(Numbers=panel_17, Mask=4)
numbers_to_points_19 = NumbersToPoints(Numbers=panel_18, Mask=4)
numbers_to_points_20 = NumbersToPoints(Numbers=panel_19, Mask=4)
numbers_to_points_21 = NumbersToPoints(Numbers=panel_21, Mask=4)
numbers_to_points_22 = NumbersToPoints(Numbers=panel_20, Mask=4)
numbers_to_points_23 = NumbersToPoints(Numbers=panel_22, Mask=4)
numbers_to_points_24 = NumbersToPoints(Numbers=panel_23, Mask=4)
panel_25 = Panel(wall.Geometry)
panel_26 = Panel(deconstruct_box.X)
panel_27 = Panel(deconstruct_box.Y)
panel_28 = Panel(deconstruct_box.Z)
xz_plane = XZPlane(Origin=box_corners.CornerF)
c_script = CSharpScript(vals=panel_13)  # -> out, A; inputs vals: list of String
# ---------- c_script: C# ----------
    List<Line> lns = new List<Line>();
    List<double> nums = new List<double>();
    List<string> dat = new List<string>();

    for(int i = 0; i < vals.Count; i++){
      string[] val = vals[i].Split(' ');
           
    //  dat.AddRange(val);
      for(int j = 0; j < val.Length; j++){
       string v = val[j].Replace('(', ' ');
        v = v.Replace(')', ' ');
        v = v.Replace(',', ' ');
        dat.Add(v);
       double num;

        if(double.TryParse(v, out num)){
          nums.Add(num);
        }
        
      }
    }


    A = dat;
# ---------- end c_script ----------
aligned_dimension = AlignedDimension(Plane=xz_plane, PointA=box_corners.CornerB, PointB=box_corners.CornerF, Offset=1, Text="{0:0.00}", Size=1)
distance = Distance(PointA=box_corners.CornerA, PointB=box_corners.CornerB)
distance_2 = Distance(PointA=box_corners.CornerB, PointB=box_corners.CornerC)
distance_3 = Distance(PointA=box_corners.CornerB, PointB=box_corners.CornerF)
panel_29 = Panel(c_script.A)
aligned_dimension_2 = AlignedDimension(Plane=PlaneXY(0, 0, 0), PointA=box_corners.CornerB, PointB=box_corners.CornerC, Offset=1, Text="{0:0.00}", Size=1)

# ----
# Include geometry objects not visible
# ViewDetail - Fine - geo element
# geo element - solid
# solid - edge array
# List of 12 edges - edge
# edge - ascurve
# as curve - line
# line - tesselate
# tesselate - xyz, xyz
panel_30 = Panel("""-0.161300526
-1.631089766
10.000000000""")
panel_31 = Panel("""-9.494633859
-1.631089766
10.000000000""")
panel_32 = Panel("""-9.494633859
-1.631089766
10.000000000""")
panel_33 = Panel("""-9.494633859
-15.964423099
10.000000000""")
panel_34 = Panel("""-9.494633859
-15.964423099
10.000000000""")
panel_35 = Panel("""-0.161300526
-15.964423099
10.000000000""")
panel_36 = Panel("""-0.161300526
-15.964423099
10.000000000""")
panel_37 = Panel("""-0.161300526
-1.631089766
10.000000000""")
panel_38 = Panel("""-0.161300526
-1.631089766
0.000000000""")
panel_39 = Panel("""-0.161300526
-15.964423099
0.000000000""")
panel_40 = Panel("""-0.161300526
-15.964423099
0.000000000""")
panel_41 = Panel("""-9.494633859
-15.964423099
0.000000000""")
panel_42 = Panel("""-9.494633859
-15.964423099
0.000000000""")
panel_43 = Panel("""-9.494633859
-1.631089766
0.000000000""")
panel_44 = Panel("""-9.494633859
-1.631089766
0.000000000""")
panel_45 = Panel("""-0.161300526
-1.631089766
0.000000000""")
panel_46 = Panel("""-0.161300526
-1.631089766
10.000000000""")
panel_47 = Panel("""-0.161300526
-1.631089766
0.000000000""")
panel_48 = Panel("""-9.494633859
-1.631089766
0.000000000""")
panel_49 = Panel("""-9.494633859
-1.631089766
10.000000000""")
panel_50 = Panel("""-9.494633859
-15.964423099
0.000000000""")
panel_51 = Panel("""-9.494633859
-15.964423099
10.000000000""")
panel_52 = Panel("""-0.161300526
-15.964423099
0.000000000""")
panel_53 = Panel("""-0.161300526
-15.964423099
10.000000000""")
numbers_to_points_25 = NumbersToPoints(Numbers=panel_30, Mask=4)
numbers_to_points_26 = NumbersToPoints(Numbers=panel_31, Mask=4)
numbers_to_points_27 = NumbersToPoints(Numbers=panel_32, Mask=4)
numbers_to_points_28 = NumbersToPoints(Numbers=panel_33, Mask=4)
numbers_to_points_29 = NumbersToPoints(Numbers=panel_34, Mask=4)
numbers_to_points_30 = NumbersToPoints(Numbers=panel_35, Mask=4)
numbers_to_points_31 = NumbersToPoints(Numbers=panel_36, Mask=4)
numbers_to_points_32 = NumbersToPoints(Numbers=panel_37, Mask=4)
numbers_to_points_33 = NumbersToPoints(Numbers=panel_38, Mask=4)
numbers_to_points_34 = NumbersToPoints(Numbers=panel_39, Mask=4)
numbers_to_points_35 = NumbersToPoints(Numbers=panel_40, Mask=4)
numbers_to_points_36 = NumbersToPoints(Numbers=panel_41, Mask=4)
numbers_to_points_37 = NumbersToPoints(Numbers=panel_42, Mask=4)
numbers_to_points_38 = NumbersToPoints(Numbers=panel_43, Mask=4)
numbers_to_points_39 = NumbersToPoints(Numbers=panel_44, Mask=4)
numbers_to_points_40 = NumbersToPoints(Numbers=panel_45, Mask=4)
numbers_to_points_41 = NumbersToPoints(Numbers=panel_46, Mask=4)
numbers_to_points_42 = NumbersToPoints(Numbers=panel_47, Mask=4)
numbers_to_points_43 = NumbersToPoints(Numbers=panel_48, Mask=4)
numbers_to_points_44 = NumbersToPoints(Numbers=panel_49, Mask=4)
numbers_to_points_45 = NumbersToPoints(Numbers=panel_50, Mask=4)
numbers_to_points_46 = NumbersToPoints(Numbers=panel_51, Mask=4)
numbers_to_points_47 = NumbersToPoints(Numbers=panel_52, Mask=4)
numbers_to_points_48 = NumbersToPoints(Numbers=panel_53, Mask=4)
line = Line(StartPoint=numbers_to_points_25, EndPoint=numbers_to_points_26)
line_2 = Line(StartPoint=numbers_to_points_27, EndPoint=numbers_to_points_28)
line_3 = Line(StartPoint=numbers_to_points_29, EndPoint=numbers_to_points_30)
line_4 = Line(StartPoint=numbers_to_points_31, EndPoint=numbers_to_points_32)
line_5 = Line(StartPoint=numbers_to_points_33, EndPoint=numbers_to_points_34)
line_6 = Line(StartPoint=numbers_to_points_35, EndPoint=numbers_to_points_36)
line_7 = Line(StartPoint=numbers_to_points_37, EndPoint=numbers_to_points_38)
line_8 = Line(StartPoint=numbers_to_points_39, EndPoint=numbers_to_points_40)
line_9 = Line(StartPoint=numbers_to_points_41, EndPoint=numbers_to_points_42)
line_10 = Line(StartPoint=numbers_to_points_43, EndPoint=numbers_to_points_44)
line_11 = Line(StartPoint=numbers_to_points_45, EndPoint=numbers_to_points_46)
line_12 = Line(StartPoint=numbers_to_points_47, EndPoint=numbers_to_points_48)
merge = Merge(
    Data1=line,
    Data2=line_2,
    Data3=line_3,
    Data4=line_4,
    Data5=line_5,
    Data6=line_6,
    Data7=line_7,
    Data8=line_8,
    Data9=line_9,
    Data10=line_10,
    Data11=line_11,
    Data12=line_12)
join_curves = JoinCurves(Curves=merge, Preserve=False)
panel_54 = Panel(join_curves)

panel_55 = Panel(distance)
panel_56 = Panel(distance_2)
panel_57 = Panel(distance_3)
aligned_dimension_3 = AlignedDimension(Plane=PlaneXY(0, 0, 0), PointA=box_corners.CornerA, PointB=box_corners.CornerB, Offset=1, Text="{0:0.00}", Size=1)
panel_58 = Panel("Unbound Height = 10")

location_point = Panel("""-5.08448454273062
-8.38817915252346
0""")
numbers_to_points_49 = NumbersToPoints(Numbers=location_point, Mask=4)

multiplication = Multiplication(A=panel_55, B=panel_56)
surface_area = Panel(multiplication)

multiplication_2 = Multiplication(A=panel_55, B="2")
multiplication_3 = Multiplication(A="2", B=panel_56)
addition = Addition(A=multiplication_2, B=multiplication_3)
perimiter = Panel(addition)
